# Grasshopper definition example_003-3dAreaLoads.gh (Grasshopper 0.9.76)
# plug-ins: MeshEdit Components, DynamicMass, Starling

# ---- group: Input curves
crv = Curve([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])

# ----
line = Line(crv)

# ---- group: Find nodes of valency <3
pmconnvert = PmConnectedVertices(Polylines=line)
lng = ListLength(List=pmconnvert)  # -> flatten(Length)
smaller = SmallerThan(FirstNumber=lng, SecondNumber="3")  # -> SmallerThan, OrEqualTo

# ----
pmcomp = PmDecompose(Polylines=line)  # -> Vertices, Faces
dispatch = Dispatch(List=flatten(pmcomp.Vertices), DispatchPattern=smaller.SmallerThan)  # -> ListA, ListB

# ---- group: Supports
msphere = MeshSphere(Base=dispatch.ListA, Radius=Slider(0.1, range=0..0.1), UCount=10, VCount=20)
preview = CustomPreview(Geometry=msphere, Shader=ColourSwatch(SwatchColor=RGB(255, 0, 0)))

# ---- group: Random spring stiffnesses
lng_2 = ListLength(List=line)
# Tweak graviational constant >>
random = Random(Range=Domain(10, 20), Number=lng_2, Seed="4")

# ----
# Reset like Kangaroo
toggle = BooleanToggle(False)
# Enable timer
timer = Timer(TimerInterval=20, Target=dynamicmass)  # disabled
dynamicmass = DynamicMass(
    Nodes=pmcomp.Vertices,
    Springs=line,
    Supports=dispatch.ListA,
    Stiffnesses=random,
    NatLengths=0,
    MassDensity=1,
    MassType="2",
    Damping=Slider(0.95, range=0..1),
    Gravity=Slider(0.6, range=-10..10),
    TimeStep=Slider(0.006, range=0..0.01),
    Reset=toggle)  # -> Nodes, Valence, Masses, Bars, Forces, Iterations, Neighbours, Meshes
number_slider = Slider(6, range=0..10)

# ---- group: Area approximation used for area load
mesh = Mesh(dynamicmass.Meshes)

# ----
multiplication = Multiplication(A=dynamicmass.Masses, B="0.1")
# Visulise mass value
preview_2 = CustomPreview(Geometry=dynamicmass.Bars, Shader=ColourSwatch(SwatchColor=RGB(64, 64, 64)))
preview_3 = CustomPreview(Geometry=mesh, Shader=ColourSwatch(SwatchColor=RGBA(255, 255, 109, 82)))
msphere_2 = MeshSphere(Base=dynamicmass.Nodes, Radius=multiplication, UCount=number_slider, VCount=number_slider)
area = MeshArea(Mesh=msphere_2)  # -> Area, Centroid
bnd = Bounds(Numbers=area.Area)
dedomain = DeconstructDomain(Domain=bnd)  # -> Start, End
gradient = Gradient(LowerLimit=dedomain.Start, UpperLimit=dedomain.End, Parameter=area.Area, stops=[0: RGB(255, 255, 255), 1: RGB(0, 0, 0)])
preview_4 = CustomPreview(Geometry=msphere_2, Shader=gradient)
